# Grasshopper definition TTC_Workflow_V1.gh (Grasshopper 1.0.8)
# plug-ins: Karamba3D

# ----
# INPUT for LLM:
# 
# "You can choose from this list of Crosssections"
crosecrselect = CrossSectionRangeSelectorKaramba3D(MaximumHeight_cm=-1, MaximumWidth_cm=-1, menu=[dropdown(1), dropdown(1), dropdown(2), dropdown(0)])
panel = Panel(crosecrselect)
item = ListItem(List=crosecrselect, Index=Slider(8, range=0..50), Wrap=True)

ttc_interpreter = Python3Script(prompt="Create a Warren Truss spanning 5 metres.", run=Button())  # -> out, run_id, run_commentary, communication; inputs prompt: String, run: Boolean
# ---------- ttc_interpreter: Python ----------
# GH component 1: Send user prompt to interpreter and start the pipeline.
#
# GHPython (CPython 3, Rhino 8):
#   Input  prompt: str — user prompt (e.g. "gable truss 12 m span, steel")
#   Input  run:    wire Button — click to run
#   Output communication: str (LLM message; includes error text if the pipeline failed)
#   Output run_id: str — use this in the fetch-output component to get Karamba data
#   Output run_commentary: str (step-by-step log: run_id, Interpreting..., Generating..., Executing..., Done)

import os
import sys

REPO_ROOT = r"C:\Users\levin\Documents\GitHub\gh-text-to-code-ai-integration"
SCRIPTS_DIR = os.path.join(REPO_ROOT, "03_python")
if SCRIPTS_DIR not in sys.path:
    sys.path.insert(0, SCRIPTS_DIR)

_env_path = os.path.join(REPO_ROOT, "00_setup", ".env")
if os.path.isfile(_env_path):
    try:
        from dotenv import load_dotenv
        load_dotenv(_env_path)
    except ImportError:
        pass
    if not (os.environ.get("ANTHROPIC_API_KEY") or os.environ.get("CLAUDE_API_KEY")):
        with open(_env_path) as _f:
            for _line in _f:
                _line = _line.strip()
                if _line and not _line.startswith("#") and "=" in _line:
                    _k, _, _v = _line.partition("=")
                    _k, _v = _k.strip(), _v.strip()
                    if _v.startswith('"') and _v.endswith('"'): _v = _v[1:-1]
                    elif _v.startswith("'") and _v.endswith("'"): _v = _v[1:-1]
                    if _k:
                        os.environ.setdefault(_k, _v)

from ttc_main import run as run_pipeline

prompt_text = str(prompt).strip() if prompt else ""
if not prompt_text:
    communication = "No prompt provided."
    run_id = ""
    run_commentary = ""
else:
    out = run_pipeline(prompt_text, run_id=None)
    communication = out.get("communication", "")
    err = out.get("error")
    if err:
        communication = (communication.strip() + "\n\nError: " + str(err)) if communication else ("Error: " + str(err))
    run_id = out.get("run_id", "")
    run_commentary = out.get("run_commentary", "")
# ---------- end ttc_interpreter ----------
panel_2 = Panel(ttc_interpreter.run_id)
panel_3 = Panel(ttc_interpreter.run_commentary)
panel_4 = Panel(ttc_interpreter.communication)
ttc_interpreter_2 = Python3Script()  # -> out, run_id, structure, answer; inputs prompt: String, run: Boolean
# ---------- ttc_interpreter_2: Python ----------
# Copy this script into a GHPython component (CPython 3, Rhino 8).
# Input 1: prompt (str) — original user prompt: what kind of structure they want to design
# Input 2: run — wire Button here; click to run (each run creates a new run_id)
# Output 1: out — same as answer (communication from LLM)
# Output 2: run_id — id for this run (for Generator step)
# Output 3: structure — filled JSON (dict)
# Output 4: answer — communication: questions for clarification or brief summary

import os
import sys

REPO_ROOT = r"C:\Users\levin\Documents\GitHub\gh-text-to-code-ai-integration"  # change if repo is elsewhere
SCRIPTS_DIR = os.path.join(REPO_ROOT, "03_python")

if SCRIPTS_DIR not in sys.path:
    sys.path.insert(0, SCRIPTS_DIR)

# Load API keys from .env at repo root (works without python-dotenv, e.g. in Rhino)
_env_path = os.path.join(REPO_ROOT, ".env")
if os.path.isfile(_env_path):
    try:
        from dotenv import load_dotenv
        load_dotenv(_env_path)
    except ImportError:
        pass
    # Fallback: read .env manually so it works in Rhino when dotenv isn't installed
    if not (os.environ.get("ANTHROPIC_API_KEY") or os.environ.get("CLAUDE_API_KEY")):
        with open(_env_path) as _f:
            for _line in _f:
                _line = _line.strip()
                if _line and not _line.startswith("#") and "=" in _line:
                    _k, _, _v = _line.partition("=")
                    _k, _v = _k.strip(), _v.strip()
                    if _v.startswith('"') and _v.endswith('"'): _v = _v[1:-1]
                    elif _v.startswith("'") and _v.endswith("'"): _v = _v[1:-1]
                    if _k: os.environ.setdefault(_k, _v)

from ttc_interpreter import parse_prompt_to_structured, get_latest_run_id

# Inputs from GH are named: prompt, run (use those names in the component)
prompt_text = str(prompt).strip() if prompt else ""
if not prompt_text:
    out = "No prompt provided."
    run_id = get_latest_run_id() or ""
    structure = {}
    answer = out
else:
    structured_prompt, communication, run_id = parse_prompt_to_structured(prompt_text, run_id=None)
    out = communication
    run_id = run_id
    structure = structured_prompt
    answer = communication

# GHPython outputs (order: out, run_id, structure, answer)
a = out
b = run_id
c = structure
d = answer
# ---------- end ttc_interpreter_2 ----------

# ----
# Test Geometry
_01_test_geometry = _01_Test_Geometry()
load_point_selection = Load_Point_Selection(C=_01_test_geometry)
support_selection = Support_Selection(C=_01_test_geometry)
data = Data(_01_test_geometry)
data_2 = Data(support_selection)
data_3 = Data(load_point_selection)

lng = ListLength(List=load_point_selection)
neg = Negative(Value=Slider(50, range=0..100))
dup = DuplicateData(Data=neg, Number=lng, Order=True)
Z = UnitZ(Factor=dup)

loads = Data(Z)

# ----
# Karamba Analysis Workflow
line_elements = Data(data)
support_points = Data(data_2)
loads_2 = Data(loads)
crosec = Data(item)
load_points = Data(data_3)

crosecselect = CrossSectionSelectorKaramba3D(CrossSections=crosec)  # -> CrossSection, Info
supp = SupportKaramba3D(PosInd=support_points, Ct_kN_m=Vector(0, 0, 0), Cr_kNm_rad=Vector(0, 0, 0), menu=[buttons(on, on, on, on, on, on)])
loads_3 = LoadsKaramba3D(ForceVector=loads_2, Local=False, PosInd=load_points, LCase="LC0", mode="Point")
loads_4 = LoadsKaramba3D(Vector=Vector(0, 0, -1), LCase="LC0", mode="Gravity")
lineelem = CreateLinearElementKaramba3D(
    Line=line_elements,
    CrossSection=crosecselect.CrossSection,
    LimitDistance_m=0.005,
    BucklingLengthY_m=-1,
    BucklingLengthZ_m=-1,
    BucklingLengthLT_m=-1,
    Bending=True,
    ToPolylineMaxAngle=0.25,
    ToPolylineTolerance=0.1,
    ToPolylineMaxEdgeLength=0.25,
    New=True,
    Remove=True,
    mode="LineToBeam",
    GuidGeneratorSeed=-236662677)  # -> Element, Points, Info
merge = Merge(Data1=loads_3, Data2=loads_4)  # -> flatten(Result)

assemble = AssembleModelKaramba3D(Elem=lineelem.Element, Support=supp, Load=merge, LimitDistance_m=0.005)  # -> Model, Info, Mass_kg, CentreOfGravity, LoadCaseNames
analyse = AnalyseKaramba3D(Model=assemble.Model)  # -> AnalysedModel, MaximumDisplacement_cm, ResultingForce_kN, ChangeOfElasticEnergy_kNm
modelview = ModelViewKaramba3D(Model=analyse.AnalysedModel)  # -> Model, DeformedMesh, DeformedAxes, DeformedModel, MaximumDeformation
beamview = BeamViewKaramba3D(Model=modelview.Model)  # -> Model, MeshesOfRenderedBeams, DeformedBeamAxes, LegendColours, LegendTags
legend = LegendKaramba3D(
    Colors=beamview.LegendColours,
    Tags=beamview.LegendTags,
    Scale=0.8,
    Textsize=30,
    Legend_HasHeader=False,
    Legend_Justification=2,
    Legend_Position=2)

# ==== cluster _01_Test_Geometry
pipeline = GeometryPipeline(
    GroupByLayer=False,
    GroupByType=False,
    IncludeHidden=True,
    IncludeLocked=True,
    LayerFilter="01__Text Geometry",
    NameFilter="*",
    SublayerFiltering=True,
    TypeFilter=4)
split = SplitList(List=pipeline, Index="1")  # -> ListA, ListB
clx = CurveLine(Curve=split.ListA, Line=split.ListB)  # -> flatten(Points), flatten(Params), Count
cullpt = CullDuplicates(Points=clx.Points, Tolerance=0.1, CullMode=1)  # -> Points, Indices, Valence
item = ListItem(List=clx.Params, Index=cullpt.Indices, Wrap=True)
shatter = Shatter(Curve=split.ListA, Parameters=item)  # -> flatten(Segments)
explode = Explode(Curve=shatter, Recursive=True)  # -> flatten(Segments), Vertices
data = Data(split.ListB)
merge = Merge(Data1=explode.Segments, Data2=data)  # -> flatten(Line_Elements)
line_elements = ClusterOutput(merge)

# ==== cluster Load_Point_Selection
C = ClusterInput()
end = EndPoints(Curve=C)  # -> Start, End
merge = Merge(Data1=end.Start, Data2=end.End)  # -> flatten(Result)
rdpoints = RemoveDuplicatePointsKaramba3D(Point=merge, LimitDistance=0.005)  # -> OutPoint, Info, Indexes
pdecon = Deconstruct(Point=rdpoints.OutPoint)  # -> XComponent, YComponent, ZComponent
larger = LargerThan(FirstNumber=pdecon.ZComponent, SecondNumber=Slider(3.37, range=0..10))  # -> LargerThan, OrEqualTo
cull = CullPattern(List=rdpoints.OutPoint, CullPattern=larger.LargerThan)
loads_top_chord = ClusterOutput(cull)

# ==== cluster Support_Selection
C = ClusterInput()
end = EndPoints(Curve=C)  # -> Start, End
merge = Merge(Data1=end.Start, Data2=end.End)  # -> flatten(Result)
rdpoints = RemoveDuplicatePointsKaramba3D(Point=merge, LimitDistance=0.005)  # -> OutPoint, Info, Indexes
pdecon = Deconstruct(Point=rdpoints.OutPoint)  # -> XComponent, YComponent, ZComponent
larger = LargerThan(FirstNumber=pdecon.ZComponent, SecondNumber=Slider(3.37, range=0..10))  # -> LargerThan, OrEqualTo
cull = CullPattern(List=rdpoints.OutPoint, CullPattern=invert(larger.LargerThan))
pdecon_2 = Deconstruct(Point=cull)  # -> XComponent, YComponent, ZComponent
sort = SortList(Keys=pdecon_2.XComponent, ValuesA=cull)  # -> Keys, ValuesA
panel = Panel("""0
-1""")
item = ListItem(List=sort.ValuesA, Index=panel, Wrap=True)  # -> flatten(Item)
i = ClusterOutput(item)
